# Dynamo graph Matplot2Demo.dyn "Matplot2" (Dynamo 2.13.0.2751)

python_script = Python()  # CPython3; unwired: IN[0]
# ---------- python_script.python (93 lines) ----------
import sys
import clr
import System
clr.AddReference('ProtoGeometry')
from Autodesk.DesignScript.Geometry import *
dirAppLoc = System.Environment.GetFolderPath(System.Environment.SpecialFolder.LocalApplicationData) 
sys.path.append(r'C:\Users\Chuong.Ho\appdata\local\programs\python\python38\lib\site-packages')

clr.AddReference('System.Drawing')
import System.Drawing
from System.Drawing import *
from System.Drawing.Imaging import *
from System.IO import MemoryStream

import numpy as np
import matplotlib.pyplot as plt
from PIL import Image
import io
import math

def plt2arr(fig):
    """
    need to draw if figure is not drawn yet
    """
    fig.canvas.draw()
    rgba_buf = fig.canvas.buffer_rgba()
    (w,h) = fig.canvas.get_width_height()
    rgba_arr = np.frombuffer(rgba_buf, dtype=np.uint8).reshape((h,w,4))
    return rgba_arr

def convertToBitmap2(npImgArray):
    bitmap_ = None
    # remove alpha
    if npImgArray.ndim == 3 and npImgArray.shape[-1] == 4:
        npImgArray = npImgArray[:, :, :-1]
    # convert to PIL Image
    if npImgArray.ndim == 3:
        image = Image.fromarray(npImgArray, "RGB")
    else:
        image = Image.fromarray(npImgArray, "L")
    # convert to Python ByteArray
    byteIO = io.BytesIO()
    image.save(byteIO, format='BMP')
    byteArr = byteIO.getvalue()
    # convert to Net ByteArray
    netBytes = System.Array[System.Byte](byteArr)
    with MemoryStream(netBytes) as ms:
        bitmap_ = Bitmap(ms)
    return bitmap_

#Plot 2D data on 3D plot
fig = plt.figure(figsize =(8,5))
ax = fig.add_subplot(projection='3d')

# Plot a sin curve using the x and y axes.
x = np.linspace(0, 1, 100)
y = np.sin(x * 2 * np.pi) / 2 + 0.5
ax.plot(x, y, zs=0, zdir='z', label='curve in (x, y)')

# Plot scatterplot data (20 2D points per colour) on the x and z axes.
colors = ('r', 'g', 'b', 'k')

# Fixing random state for reproducibility
np.random.seed(19680801)

x = np.random.sample(20 * len(colors))
y = np.random.sample(20 * len(colors))
c_list = []
for c in colors:
    c_list.extend([c] * 20)
# By using zdir='y', the y value of these points is fixed to the zs value 0
# and the (x, y) points are plotted on the x and z axes.
ax.scatter(x, y, zs=0, zdir='y', c=c_list, label='points in (x, z)')

# Make legend, set axes limits and labels
ax.legend()
ax.set_xlim(0, 1)
ax.set_ylim(0, 1)
ax.set_zlim(0, 1)
ax.set_xlabel('X')
ax.set_ylabel('Y')
ax.set_zlabel('Z')

# Customize the view angle so it's easier to see that the scatter points lie
# on the plane y=0
ax.view_init(elev=20., azim=-35)

#plt.show()

image_from_plot = plt2arr(fig)
bitmap1 = convertToBitmap2(image_from_plot)

OUT = bitmap1
# ----------------------------------------
watch_image = WatchImageCore(image=python_script)
