# Dynamo graph demo.dyn "dewedwa" (Dynamo 2.12.0.5650)

python_script = Python()  # CPython3; unwired: IN[0]
# ---------- python_script.python (8 lines) ----------
import sys
import os

localapp = os.getenv(r'LOCALAPPDATA')

sys.path.append(r'C:\Users\Chuong.Ho\appdata\local\programs\python\python38\lib\site-packages')
import numpy as np
OUT = np.array([1,2,3,4,5,6])
# ----------------------------------------
